# Grasshopper definition ParametricKit.gh (Grasshopper 1.0.7)

sph = Sphere(Base=PlaneXY(0, 0, 0), Radius=Slider(42, range=0..100))
python = GhPythonScript(sphere=sph)  # -> out, a
# ---------- python: Python ----------
__author__ = "andy"

import rhinoscriptsyntax as rs

import Rhino.Geometry as rg

bbox = rg.GeometryBase.GetBoundingBox(rs.coercebrep(sphere),False)
print(bbox.Min)
# ---------- end python ----------
